# Dynamo graph Fix SheetNum from printer_script.dyn (Dynamo 2.3.0.5885)

code_block = CodeBlock { "Sheets"; }
byName = Category.ByName(name=code_block)
all_elements_of_category = ElementsOfCategory(Category=byName)
code_block_2 = CodeBlock { "Sheet Number"; }
sheetNumber = Sheet.SheetNumber(sheet=all_elements_of_category)
python_script = Python(IN[0]=sheetNumber)
# ---------- python_script.python (7 lines) ----------
names = IN[0]
temp = []
NPC = u'\u200e'
for name in names:
	new_name = name.replace(NPC, '')
	temp.append(new_name)
OUT = temp
# ----------------------------------------
setParameterByName = Element.SetParameterByName(element=all_elements_of_category, parameterName=code_block_2, value=python_script)
