# Dynamo graph Update Sheet Scale_script.dyn (Dynamo 2.3.0.5885)

code_block = CodeBlock { "Sheets"; }
byName = Category.ByName(name=code_block)
all_elements_of_category = ElementsOfCategory(Category=byName)
code_block_2 = CodeBlock { "Sheet_Scale"; }
code_block_3 = CodeBlock { "Scale"; }
getParameterValueByName = Element.GetParameterValueByName(element=all_elements_of_category, parameterName=code_block_3)
setParameterByName = Element.SetParameterByName(element=all_elements_of_category, parameterName=code_block_2, value=getParameterValueByName)
