# Dynamo graph get all grids_script.dyn (Dynamo 2.0.2.6826)

code_block = CodeBlock { "Grids"; }
byName = Category.ByName(name=code_block)
all_elements_of_category = ElementsOfCategory(Category=byName)
code_block_2 = CodeBlock { "Name"; }
getParameterValueByName = Element.GetParameterValueByName(element=all_elements_of_category, parameterName=code_block_2)
string = StringInput("_123")  # graph input
python_script = Python(IN[0]=getParameterValueByName, IN[1]=string)
# ---------- python_script.python (4 lines) ----------
OUT = []
end = IN[1]
for item in IN[0]:
	OUT.append(item + end)
# ----------------------------------------
setParameterByName = Element.SetParameterByName(element=all_elements_of_category, parameterName=code_block_2, value=python_script)
