# Grasshopper definition convert_to_Rhino_script.gh (Grasshopper 1.0.7)
# plug-ins: Rhino.Inside for Autodesk Revit

agraphview = ActiveGraphicalView()
vieweles = QueryViewElements(View=agraphview)
graphical_element = GraphicalElement(vieweles)
panel = Panel(graphical_element)
importer_quick = GeometryCache(graphical_element, MaintainReferences=False)
