# Grasshopper definition EnneadTab Core GH Collection.gh (Grasshopper 1.0.7)
# plug-ins: eleFront

get_all_lenox_scripts = GetAllLenoxScripts()  # -> scripts, helpdocs
panel = Panel(get_all_lenox_scripts.scripts)
item = ListItem(List=panel, Index=Slider(0, range=0..10), Wrap=True)  # -> Item, Item1
panel_2 = Panel(item.Item1)
panel_3 = Panel(item.Item)

# ----
# Import Weather Data
panel_4 = Panel("http://climate.onebuilding.org/WMO_Region_4_North_and_Central_America/USA_United_States_of_America/WI_Wisconsin/USA_WI_Madison-Dane.County.Rgnl.AP-Truax.Field.726410_TMY3.zip")  # disabled
downloadepw = LBDownloadWeather(weather_URL=panel_4)  # -> epw_file, stat_file, ddy_file; disabled; plug-in component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
importepw = LBImportEPW(epw_file=downloadepw.epw_file)  # -> location, dry_bulb_temperature, dew_point_temperature, relative_humidity, wind_speed, wind_direction, direct_normal_rad, diffuse_horizontal_rad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; disabled; plug-in component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
importstat = LBImportSTAT(stat_file=downloadepw.stat_file)  # -> location, ashrae_zone, koppen_zone, clear_dir_norm_rad, clear_diff_horiz_rad, ann_heat_dday_996, ann_heat_dday_990, ann_cool_dday_004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; disabled; plug-in component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

panel_5 = Panel(get_all_lenox_scripts.helpdocs)
get_script_path_by_name = GetScriptPathByName(scriptname="sample.py", isenabled=Toggle(False))  # -> exceptiondoc, helpdoc, scriptpath

# ----
# Summer Design Day
# Radiation
panel_6 = Panel("21")  # disabled
panel_7 = Panel("7")  # disabled
analysisperiod = LBAnalysisPeriod(start_month=panel_7, start_day=panel_6, start_hour=0, end_month=panel_7, end_day=panel_6)  # -> period, hoys, dates; disabled; plug-in component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
panel_8 = Panel("20")  # disabled
skymatrix = LBCumulativeSkyMatrix(
    north=panel_8,
    location=importstat.location,
    direct_rad=importstat.clear_dir_norm_rad,
    diffuse_rad=importstat.clear_diff_horiz_rad,
    hoys=analysisperiod.hoys)  # -> report, sky_mtx; disabled; plug-in component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

# ----
# Annual Radiation
# Benefit/Harm
panel_9 = Panel("60")  # disabled
benefitmatrix = LBBenefitSkyMatrix(
    north=panel_9,
    location=importepw.location,
    temperature=importepw.dry_bulb_temperature,
    direct_rad=importepw.direct_normal_rad,
    diffuse_rad=importepw.diffuse_horizontal_rad)  # -> report, sky_mtx; disabled; plug-in component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

# ----
# Annual Radiation
panel_10 = Panel("-150")  # disabled
skymatrix_2 = LBCumulativeSkyMatrix(
    north=panel_10,
    location=importepw.location,
    direct_rad=importepw.direct_normal_rad,
    diffuse_rad=importepw.diffuse_horizontal_rad)  # -> report, sky_mtx; disabled; plug-in component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

panel_11 = Panel(get_script_path_by_name.exceptiondoc)
panel_12 = Panel(get_script_path_by_name.helpdoc)
get_script_path_by_name_2 = GetScriptPathByName(scriptname="get_geo_by_cate.py", isenabled=Toggle(True))  # -> exceptiondoc, helpdoc, scriptpath
get_script_path_by_name_3 = GetScriptPathByName(scriptname="get_patient_unit.py", isenabled=Toggle(False))  # -> exceptiondoc, helpdoc, scriptpath
get_script_path_by_name_4 = GetScriptPathByName(scriptname="create_pollination_room.py", isenabled=Toggle(True))  # -> exceptiondoc, helpdoc, scriptpath
get_script_path_by_name_5 = GetScriptPathByName(scriptname="get_block_transform_on_crv.py", isenabled=Toggle(True))  # -> exceptiondoc, helpdoc, scriptpath
get_script_path_by_name_6 = GetScriptPathByName(scriptname="decompose_massing.py", isenabled=Toggle(True))  # -> exceptiondoc, helpdoc, scriptpath
panel_13 = Panel(get_script_path_by_name_2.exceptiondoc)
panel_14 = Panel(get_script_path_by_name_3.exceptiondoc)

location_crvs = Curve(simplify(<curve referenced from the Rhino model>))
list = ValueList({"opt 1", "opt 2"}, selected="opt 1")

panel_15 = Panel(get_script_path_by_name_4.exceptiondoc)
panel_16 = Panel(get_script_path_by_name_3.helpdoc)
python = GhPythonScript(Code=get_script_path_by_name.scriptpath, Number_1=Slider(28, range=0..100), Number_2=Slider(42, range=0..100))  # -> Out, Result
panel_17 = Panel(get_script_path_by_name_2.helpdoc)
python_2 = GhPythonScript(Code=get_script_path_by_name_2.scriptpath)  # -> Out, Context, Receiver, Glazing, ProjectNorth

# ---- group: Run Me!
toggle = BooleanToggle(True)  # disabled

# ----
# Run Radiation Study
geo = Geometry(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)  # disabled
geo_2 = Geometry(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)  # disabled
panel_18 = Panel("0.1")  # disabled
panel_19 = Panel("5")  # disabled
incidentradiation = LBIncidentRadiation(
    sky_mtx=skymatrix_2.sky_mtx,
    geometry=flatten(geo_2),
    context=flatten(geo),
    grid_size=panel_19,
    offset_dist=panel_18,
    run=toggle)  # -> report, points, results, total, mesh, legend, title, int_mtx; disabled; plug-in component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

panel_20 = Panel(get_script_path_by_name_5.exceptiondoc)

crv = Curve(<curve referenced from the Rhino model>)
brep = Brep([<brep referenced from the Rhino model> x2])
vec = Vector(crv)

panel_21 = Panel(get_script_path_by_name_5.helpdoc)
panel_22 = Panel(get_script_path_by_name_4.helpdoc)
python_3 = GhPythonScript(
    Code=get_script_path_by_name_4.scriptpath,
    Width=Slider(3, range=0..10),
    Length=Slider(8, range=0..10),
    Height=Slider(5, range=0..10))  # -> Out, Model
list_2 = ValueList({"opt 1", "opt 2"}, selected="opt 1")

# ----
# Visualize Sky Matrix
skydome = LBSkyDome(sky_mtx=skymatrix_2.sky_mtx)  # -> report, mesh, compass, legend, title, patch_vecs, patch_values, mesh_values, vis_set; disabled; plug-in component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

panel_23 = Panel(get_script_path_by_name_6.exceptiondoc)
panel_24 = Panel(get_script_path_by_name_6.helpdoc)
xmatrix = LBDeconstructMatrix(matrix=flatten(skymatrix_2.sky_mtx))  # -> values; disabled; plug-in component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
python_4 = GhPythonScript(Code=get_script_path_by_name_3.scriptpath, OptionName=list_2)  # -> Out, FilePath, BlockDefinition
panel_25 = Panel(python.Out)
panel_26 = Panel(python.Result)
panel_27 = Panel(python_2.ProjectNorth)
panel_28 = Panel(python_2.Context)
panel_29 = Panel(python_3.Model)
panel_30 = Panel(python_3.Out)
number_slider = Slider(55, range=0..100)  # disabled
python_5 = GhPythonScript(Code=get_script_path_by_name_5.scriptpath, LocationCrvs=location_crvs, UnitWidth=Slider(20, range=0..100))  # -> Out, BlockTransforms
panel_31 = Panel(xmatrix)  # disabled
python_6 = GhPythonScript(Code=get_script_path_by_name_6.scriptpath, Massings=brep, ProjectNorth=vec)  # -> Out, RoofsOrCeilings, Floors, FacadeNorth, FacadeWest, FacadeSouth, FacadeEast
panel_32 = Panel(get_script_path_by_name_3.scriptpath)
panel_33 = Panel(python_4.FilePath)
panel_34 = Panel(python_4.BlockDefinition)
meshselector = LBMeshThresholdSelector(values=incidentradiation.results, mesh=incidentradiation.mesh, pct_threshold=number_slider)  # -> report, total_value, total_area, sub_mesh, outline; disabled; plug-in component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
panel_35 = Panel(incidentradiation.legend)  # disabled
panel_36 = Panel(python_2.Out)
insert = InsertBlock(BlockName=list, Plane=python_5.BlockTransforms)
panel_38 = Panel(python_5.Out)
radiation_in_threshold_kwh = Panel(meshselector.total_value)  # disabled
panel_39 = Panel(python_6.Floors)
panel_40 = Panel(python_6.RoofsOrCeilings)
panel_41 = Panel(python_6.FacadeWest)
panel_42 = Panel(python_6.FacadeSouth)
panel_43 = Panel(python_6.FacadeEast)
panel_44 = Panel(python_6.FacadeNorth)
panel_45 = Panel(python_6.Out)
transform = Transform()
get_script_path_by_name_7 = GetScriptPathByName(scriptname="save_study.py", isenabled=Toggle(True))  # -> exceptiondoc, helpdoc, scriptpath
num = Number(incidentradiation.results)
mesh = Mesh(incidentradiation.mesh)
subset = SubList(List=num, Domain=Slider(12, range=0..100), Wrap=True)  # -> List, Index
python_7 = GhPythonScript(Code=get_script_path_by_name_7.scriptpath, CumulativeRadiationMesh=mesh)  # -> Out, IsSaved; disabled
panel_46 = Panel(get_script_path_by_name_7.exceptiondoc)
panel_47 = Panel(get_script_path_by_name_7.helpdoc)
panel_48 = Panel(python_7.IsSaved)
panel_49 = Panel(python_7.Out)
panel_50 = Panel("C:\Users\szhang\Documents\EnneadTab Settings\Local Copy Dump")
get_script_path_by_name_8 = GetScriptPathByName(scriptname="export_study_views.py", isenabled=Toggle(False))  # -> exceptiondoc, helpdoc, scriptpath
panel_51 = Panel("""test
test2""")
panel_52 = Panel("""cam 1
cam 2""")
panel_53 = Panel(get_script_path_by_name_8.exceptiondoc)
python_8 = GhPythonScript(
    Code=get_script_path_by_name_8.scriptpath,
    StudyNames=panel_51,
    CameraNames=panel_52,
    ImageFolder=panel_50,
    IsRun=Toggle(True))  # -> Out, IsFinished
panel_54 = Panel(get_script_path_by_name_8.helpdoc)
panel_55 = Panel(python_8.IsFinished)
panel_56 = Panel(python_8.Out)
get_script_path_by_name_9 = GetScriptPathByName(scriptname="create_graphic.py", isenabled=Toggle(True))  # -> exceptiondoc, helpdoc, scriptpath
panel_57 = Panel(get_script_path_by_name_9.exceptiondoc)
python_9 = GhPythonScript(Code=get_script_path_by_name_9.scriptpath, IsRun=Toggle(True))  # -> Out, CumulativeRadiationGraphic, CumulativeRadiationGraphicTitle, CumulativeRadiationLegend
panel_58 = Panel(get_script_path_by_name_9.helpdoc)
get_script_path_by_name_10 = GetScriptPathByName(scriptname="load_study.py", isenabled=Toggle(True))  # -> exceptiondoc, helpdoc, scriptpath
panel_59 = Panel(get_script_path_by_name_10.exceptiondoc)
panel_60 = Panel(get_script_path_by_name_10.helpdoc)
python_10 = GhPythonScript(Code=get_script_path_by_name_10.scriptpath, IsRun=Toggle(True))  # -> Out, CumulativeRadiationMesh, CumulativeRadiationMeshDensity, CumulativeRadiationResult, CumulativeRadiationLegend, CumulativeRadiationGraphic, Creator, CreationDate
panel_61 = Panel(python_9.CumulativeRadiationGraphic)
X = UnitX(Factor=Slider(100, range=0..100))
move = Move(Geometry=python_10.CumulativeRadiationLegend, Motion=X)  # -> Geometry, Transform
move_2 = Move(Geometry=python_10.CumulativeRadiationMesh, Motion=X)  # -> Geometry, Transform
panel_62 = Panel(python_10.CumulativeRadiationResult)
meshselector_2 = LBMeshThresholdSelector(values=python_10.CumulativeRadiationResult, mesh=move_2.Geometry, pct_threshold=Slider(55, range=0..100))  # -> report, total_value, total_area, sub_mesh, outline; plug-in component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
panel_63 = Panel(python_10.Out)

# ==== cluster GetAllLenoxScripts
panel = Panel("L:\4b_Applied Computing\03_Rhino\12_EnneadTab for Rhino\Source Codes\Grasshopper\GH_python\Lenox\_index.py")
path = FilePath(panel)
python = GhPythonScript(Code=path)  # -> flatten(Scripts), flatten(HelpDocs)
scripts = ClusterOutput(python.Scripts)
helpdocs = ClusterOutput(python.HelpDocs)
panel_2 = Panel(python.HelpDocs)

# ==== cluster GetScriptPathByName
panel = Panel("L:\4b_Applied Computing\03_Rhino\12_EnneadTab for Rhino\Source Codes\Grasshopper\GH_python\Lenox\_get_script_by_name.py")
scriptname = ClusterInput()
isenabled = ClusterInput()
python = GhPythonScript(Code=panel, ScriptName=scriptname, IsEnabled=isenabled)  # -> ExceptionDoc, HelpDoc, ScriptPath
scriptpath = ClusterOutput(python.ScriptPath)
exceptiondoc = ClusterOutput(python.ExceptionDoc)
helpdoc = ClusterOutput(python.HelpDoc)
