# Grasshopper definition shape3D_remake.gh (Grasshopper 1.0.7)
# plug-ins: Kangaroo2 Components, MeshEdit Components

brep = Brep(<brep referenced from the Rhino model>)
crv = Curve(<curve referenced from the Rhino model>)
sunion = SolidUnion(Breps=brep)
split = SplitBrep(Brep=sunion, Cutter=crv)
join = BrepJoin(Breps=split)  # -> Breps, Closed
mesh = MeshBrep(
    Brep=join.Breps,
    Settings={GridMaxCount=0, GridMinCount=16, JaggedSeams=False, MaxEdgeLength=0, MinEdgeLength=0.0001, MinTolerance=0, Refine=True, RefineAngle=0, RelativeTolerance=0.65, SimplePlanes=True, Tolerance=0})
item = ListItem(List=mesh, Index=0, Wrap=True)  # -> Item, Item1
hard_edge = BooleanToggle(True)
debrep = DeconstructBrep(Brep=join.Breps)  # -> Faces, Edges, Vertices
mmx = MeshMesh(MeshA=item.Item, MeshB=item.Item1)
panel = Panel(join.Breps)
qrsettings = QuadRemeshSettings(
    TargetCount=Slider(4845, range=0..10000),
    AdaptiveSize=0,
    AdaptiveCount=False,
    HardEdges=hard_edge,
    SeamEdges=1,
    Symmetry=0,
    GuideCurves=0)
trimap = TriangleMapping()  # -> Geometry, Transform
qrmesh = QuadRemesh(Mesh=mesh, Guides=flatten(debrep.Edges), Settings=qrsettings)
triremesh = TriRemesh(Geometry=mesh, Sharp=True, Length=Slider(100, range=0..100), Iterations=25)  # -> Triangulation, Dual, Creases
explode = MeshExplode(Mesh=triremesh.Triangulation, Interpolate=False)
area = Area(Geometry=explode)  # -> Area, Centroid
medges = MeshEdges(Mesh=triremesh.Triangulation)  # -> NakedEdges, InteriorEdges, NonManifoldEdges
preview = CustomPreview(
    Geometry=triremesh.Triangulation,
    Material={diffuse=RGB(221, 160, 221), emission=RGB(66, 48, 66), shine=0.5, specular=RGB(255, 255, 255), transparency=0})
